# Grasshopper definition 161116_Cp.gh (Grasshopper 0.9.76)
# plug-ins: GHWind

# ---- group: domainsize, cellsize, origin
pt = Point(<point referenced from the Rhino model>)
panel = Panel("5")
panel_2 = Panel(["300", "150", "100"])
panel_3 = Panel("5")
division = Division(A=["300", "150"], B=panel)
division_2 = Division(A="100", B=panel_3)
panel_4 = Panel([division, division_2])

# ----
srf = Surface([<surface referenced from the Rhino model> x2])

# ---- group: discretizer & geometry
mesh = Mesh(<mesh referenced from the Rhino model>)
discretize_meshes = GHDiscrMesh(Xyzsize=panel_2, Xyzcells=panel_4, SolidMesh=mesh, Origin=pt)  # -> Boxes, CubesAsDoubles

# ---- group: export geometry to a .csv
export_geometry = GHExportGeometry(CubesAsDoubles=discretize_meshes.CubesAsDoubles, Path="c:\_CHRIS\geometry.csv", Export=Button())

# ----
mesh_uv = MeshSurface(Surface=srf, UCount="10", VCount="10", Overhang=True, Equalize=False)

# ---- group: Solver
ffd = FFD(
    DomainSize=panel_2,
    DomainDiscretization=panel_4,
    Geometry=discretize_meshes.CubesAsDoubles,
    TimeStep="0.1",
    WindSpeed="3",
    Terrain=Slider(3, range=0..3),
    Run=Toggle(False),
    WriteGHResults=Toggle(False),
    Reset=Button(),
    Ν="1e-1")  # -> Velout, P, VStaggered, PStaggered, DE

# ---- group: run
timer = Timer(TimerInterval=500, Target=ffd)  # disabled

# ---- group: Visualize Results
number_slider = Slider(15, range=0..100)
number_slider_2 = Slider(1, range=0..2)
number_slider_3 = Slider(0, range=0..5000)
number_slider_4 = Slider(10, range=0..5000)
toggle = BooleanToggle(False)
field_visualizer = FFDDynamicFieldVisualizer(
    Origin=pt,
    XyzSection=number_slider_2,
    SectionPosition=number_slider,
    Min=number_slider_3,
    Max=number_slider_4,
    Velocity=ffd.VStaggered,
    Pressure=ffd.PStaggered,
    Hx=panel,
    Hy=panel,
    Hz=panel_3,
    ShowPressure=toggle,
    ColourSheme=Slider(1, range=0..2))
vector_visualizer = FFDDynamicVectorVisualizer(
    Origin=pt,
    XyzSection=number_slider_2,
    SectionPosition=number_slider,
    Min=number_slider_3,
    Max=number_slider_4,
    Velocity=ffd.Velout,
    Pressure=ffd.P,
    Hx=panel,
    Hy=panel,
    Hz=panel_3,
    ShowPressure=toggle,
    ColourSheme=Slider(1, range=0..2))

# ----
pt_2 = Point(<point referenced from the Rhino model>)
cp_visualizer = CpVisualizer(
    Origin=pt,
    Mesh=mesh_uv,
    DE=ffd.DE,
    Ρ="1.2",
    Min=Slider(-0.563, range=-1..0),
    Max=Slider(0.67, range=0..1),
    ColourSheme=Slider(1, range=0..2),
    FontSize=Slider(0.224, range=0..2),
    RefZ=pt_2)  # -> CpMesh, Txt, Cps
mesh_2 = Mesh(cp_visualizer.CpMesh)
panel_5 = Panel(cp_visualizer.Cps)
