# Grasshopper definition 181119_Cp_V2.gh (Grasshopper 0.9.76)
# plug-ins: GHWind

# ---- group: domainsize, cellsize, origin
pt = Point(<point referenced from the Rhino model>)
panel = Panel("5")
panel_2 = Panel(["300", "150", "100"])
panel_3 = Panel("5")
division = Division(A=["300", "150"], B=panel)
division_2 = Division(A="100", B=panel_3)
panel_4 = Panel([division, division_2])

# ----
srf = Surface([<surface referenced from the Rhino model> x2])

# ---- group: discretizer & geometry
mesh = Mesh(<mesh referenced from the Rhino model>)
discretize_meshes = GHDiscrMesh(Xyzsize=panel_2, Xyzcells=panel_4, SolidMesh=mesh, Origin=pt)  # -> Boxes, CubesAsDoubles

# ---- group: export geometry to a .csv
export_geometry = GHExportGeometry(CubesAsDoubles=discretize_meshes.CubesAsDoubles, Path="c:\_CHRIS\geometry.csv", Export=Button())

# ---- group: Solver
panel_5 = Panel("1.511e-5;1e-4;1;30;2;false;0.7;false")
panel_6 = Panel("0.1")
number_slider = Slider(3, range=0..3)
panel_7 = Panel("20")
panel_8 = Panel("3")
button = Button()
toggle = BooleanToggle(False)
toggle_2 = BooleanToggle(True)
panel_9 = Panel("20")

# ----
mesh_uv = MeshSurface(Surface=srf, UCount="10", VCount="10", Overhang=True, Equalize=False)
panel_10 = Panel("1e-1")
ffd_v2 = FFDSolverV2(
    DomainSize=panel_2,
    DomainDiscretization=panel_4,
    Geometry=discretize_meshes.CubesAsDoubles,
    TimeStep=panel_6,
    Horizon=panel_7,
    WindSpeed=panel_8,
    Terrain=number_slider,
    Run=toggle,
    Results=Toggle(True),
    Reset=button,
    SolverParameters=panel_5,
    Residuals=toggle_2,
    Mean_dt=panel_9)  # -> VCentred, PCentred, VStaggered, PStaggered, DE

# ---- group: Visualize Results
number_slider_2 = Slider(4, range=0..100)
number_slider_3 = Slider(2, range=0..2)
number_slider_4 = Slider(0, range=0..5000)
number_slider_5 = Slider(10, range=0..5000)
toggle_3 = BooleanToggle(False)
field_visualizer = FFDDynamicFieldVisualizer(
    Origin=pt,
    XyzSection=number_slider_3,
    SectionPosition=number_slider_2,
    Min=number_slider_4,
    Max=number_slider_5,
    Velocity=ffd_v2.VStaggered,
    Pressure=ffd_v2.PStaggered,
    Hx=panel,
    Hy=panel,
    Hz=panel_3,
    ShowPressure=toggle_3,
    ColourSheme=Slider(1, range=0..2))
vector_visualizer = FFDDynamicVectorVisualizer(
    Origin=pt,
    XyzSection=number_slider_3,
    SectionPosition=number_slider_2,
    Min=number_slider_4,
    Max=number_slider_5,
    Velocity=ffd_v2.VCentred,
    Pressure=ffd_v2.PCentred,
    Hx=panel,
    Hy=panel,
    Hz=panel_3,
    ShowPressure=toggle_3,
    ColourSheme=Slider(2, range=0..2))

# ----
pt_2 = Point(<point referenced from the Rhino model>)
cp_visualizer = CpVisualizer(
    Origin=pt,
    Mesh=mesh_uv,
    DE=ffd_v2.DE,
    Ρ="1.2",
    Min=Slider(0, range=-1..0),
    Max=Slider(1, range=0..1),
    ColourSheme=Slider(1, range=0..2),
    FontSize=Slider(0.05, range=0..2),
    RefZ=pt_2)  # -> CpMesh, Txt, Cps
mesh_2 = Mesh(cp_visualizer.CpMesh)
panel_11 = Panel(cp_visualizer.Cps)
