# Grasshopper definition 181210_UrbanFlow.gh (Grasshopper 0.9.76)
# plug-ins: GHWind

# ---- group: domainsize, cellsize, origin
pt = Point(<point referenced from the Rhino model>)
panel = Panel("2")
panel_2 = Panel(["500", "200", "40"])
panel_3 = Panel("4")
division = Division(A=["500", "200"], B=panel)
division_2 = Division(A="40", B=panel_3)
panel_4 = Panel([division, division_2])

# ---- group: discretizer & geometry
mesh = Mesh([<mesh referenced from the Rhino model> x9])
discretize_meshes = GHDiscrMesh(Xyzsize=panel_2, Xyzcells=panel_4, SolidMesh=mesh, Origin=pt)  # -> Boxes, CubesAsDoubles

# ----
panel_5 = Panel("1.511e-5")

# ---- group: export geometry to a .csv
export_geometry = GHExportGeometry(CubesAsDoubles=discretize_meshes.CubesAsDoubles, Path="c:\_CHRIS\geometry.csv", Export=Button())

# ---- group: Solver
panel_6 = Panel("1.511e-5;1e-4;1;10;2;false;0.7;false")
panel_7 = Panel("0.5")
number_slider = Slider(3, range=0..3)
panel_8 = Panel("50")
panel_9 = Panel("5")
button = Button()
toggle = BooleanToggle(False)
toggle_2 = BooleanToggle(True)
panel_10 = Panel("10")

# ----
ffd_v2 = FFDSolverV2(
    DomainSize=panel_2,
    DomainDiscretization=panel_4,
    Geometry=discretize_meshes.CubesAsDoubles,
    TimeStep=panel_7,
    Horizon=panel_8,
    WindSpeed=panel_9,
    Terrain=number_slider,
    Run=toggle,
    Results=Toggle(True),
    Reset=button,
    SolverParameters=panel_6,
    Residuals=toggle_2,
    Mean_dt=panel_10)  # -> VCentred, PCentred, VStaggered, PStaggered, DE

# ---- group: Visualize Results
number_slider_2 = Slider(1, range=0..100)
number_slider_3 = Slider(2, range=0..2)
number_slider_4 = Slider(0, range=0..5000)
number_slider_5 = Slider(5, range=0..5000)
toggle_3 = BooleanToggle(False)
field_visualizer = FFDDynamicFieldVisualizer(
    Origin=pt,
    XyzSection=number_slider_3,
    SectionPosition=number_slider_2,
    Min=number_slider_4,
    Max=number_slider_5,
    Velocity=ffd_v2.VStaggered,
    Pressure=ffd_v2.PStaggered,
    Hx=panel,
    Hy=panel,
    Hz=panel_3,
    ShowPressure=toggle_3,
    ColourSheme=Slider(1, range=0..2))
vector_visualizer = FFDDynamicVectorVisualizer(
    Origin=pt,
    XyzSection=number_slider_3,
    SectionPosition=number_slider_2,
    Min=number_slider_4,
    Max=number_slider_5,
    Velocity=ffd_v2.VCentred,
    Pressure=ffd_v2.PCentred,
    Hx=panel,
    Hy=panel,
    Hz=panel_3,
    ShowPressure=toggle_3,
    ColourSheme=Slider(2, range=0..2))
