# Grasshopper definition 200528_Breathability.gh (Grasshopper 1.0.7)
# plug-ins: GHWind

# ---- group: decision variables
number_slider = Slider(-1.715, range=-2.5..2.5)
number_slider_2 = Slider(-1.012, range=-2.5..2.5)
number_slider_3 = Slider(1.054, range=-2.5..2.5)
number_slider_4 = Slider(-2.5, range=-2.5..2.5)
number_slider_5 = Slider(0.4, range=0..0.5)
number_slider_6 = Slider(2.5, range=-2.5..2.5)
number_slider_7 = Slider(0.26, range=0..0.5)
number_slider_8 = Slider(-2.004, range=-2.5..2.5)
number_slider_9 = Slider(0.065, range=0..0.5)
number_slider_10 = Slider(-1.26, range=-2.5..2.5)
number_slider_11 = Slider(2.045, range=-2.5..2.5)
number_slider_12 = Slider(0.38, range=0..0.5)

# ---- group: start ffd
toggle = BooleanToggle(False)

# ----
crv = Curve(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)
pcen = PolygonCenter(Polyline=crv)  # -> CenterV, CenterE, CenterA
vec = VectorXYZ(XComponent=number_slider, YComponent=number_slider_3, ZComponent="0")  # -> Vector, Length
multiplication = Multiplication(A=number_slider_5, B="Pi")
rotate = Rotate(Geometry=crv, Angle=multiplication, Plane=pcen.CenterV)  # -> Geometry, Transform
move = Move(Geometry=rotate.Geometry, Motion=vec.Vector)  # -> Geometry, Transform
move_2 = Move(Geometry=move.Geometry, Motion="0,0,10")  # -> Geometry, Transform
extr = Extrude(Base=move.Geometry, Direction="0,0,10")
debrep = DeconstructBrep(Brep=extr)  # -> Faces, Edges, Vertices
srf = Surface([move_2.Geometry, move.Geometry])
join = BrepJoin(Breps=[extr, srf])  # -> Breps, Closed
offset = Offset(Surface=debrep.Faces, Distance="0.4", Retrim=True)

crv_2 = Curve(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)
pcen_2 = PolygonCenter(Polyline=crv_2)  # -> CenterV, CenterE, CenterA
vec_2 = VectorXYZ(XComponent=number_slider_8, YComponent=number_slider_2, ZComponent="0")  # -> Vector, Length
multiplication_2 = Multiplication(A=number_slider_9, B="Pi")
rotate_2 = Rotate(Geometry=crv_2, Angle=multiplication_2, Plane=pcen_2.CenterV)  # -> Geometry, Transform
move_3 = Move(Geometry=rotate_2.Geometry, Motion=vec_2.Vector)  # -> Geometry, Transform
move_4 = Move(Geometry=move_3.Geometry, Motion="0,0,10")  # -> Geometry, Transform
extr_2 = Extrude(Base=move_3.Geometry, Direction="0,0,10")
debrep_2 = DeconstructBrep(Brep=extr_2)  # -> Faces, Edges, Vertices
srf_2 = Surface([move_4.Geometry, move_3.Geometry])
join_2 = BrepJoin(Breps=[extr_2, srf_2])  # -> Breps, Closed
offset_2 = Offset(Surface=debrep_2.Faces, Distance="0.4", Retrim=True)

crv_3 = Curve(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)
pcen_3 = PolygonCenter(Polyline=crv_3)  # -> CenterV, CenterE, CenterA
vec_3 = VectorXYZ(XComponent=number_slider_11, YComponent=number_slider_10, ZComponent="0")  # -> Vector, Length
multiplication_3 = Multiplication(A=number_slider_12, B="Pi")
rotate_3 = Rotate(Geometry=crv_3, Angle=multiplication_3, Plane=pcen_3.CenterV)  # -> Geometry, Transform
move_5 = Move(Geometry=rotate_3.Geometry, Motion=vec_3.Vector)  # -> Geometry, Transform
move_6 = Move(Geometry=move_5.Geometry, Motion="0,0,10")  # -> Geometry, Transform
extr_3 = Extrude(Base=move_5.Geometry, Direction="0,0,10")
debrep_3 = DeconstructBrep(Brep=extr_3)  # -> Faces, Edges, Vertices
srf_3 = Surface([move_6.Geometry, move_5.Geometry])
join_3 = BrepJoin(Breps=[extr_3, srf_3])  # -> Breps, Closed
offset_3 = Offset(Surface=debrep_3.Faces, Distance="0.4", Retrim=True)

crv_4 = Curve(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)
pcen_4 = PolygonCenter(Polyline=crv_4)  # -> CenterV, CenterE, CenterA
vec_4 = VectorXYZ(XComponent=number_slider_6, YComponent=number_slider_4, ZComponent="0")  # -> Vector, Length
multiplication_4 = Multiplication(A=number_slider_7, B="Pi")
rotate_4 = Rotate(Geometry=crv_4, Angle=multiplication_4, Plane=pcen_4.CenterV)  # -> Geometry, Transform
move_7 = Move(Geometry=rotate_4.Geometry, Motion=vec_4.Vector)  # -> Geometry, Transform
move_8 = Move(Geometry=move_7.Geometry, Motion="0,0,10")  # -> Geometry, Transform
extr_4 = Extrude(Base=move_7.Geometry, Direction="0,0,10")
debrep_4 = DeconstructBrep(Brep=extr_4)  # -> Faces, Edges, Vertices
srf_4 = Surface([move_8.Geometry, move_7.Geometry])
join_4 = BrepJoin(Breps=[extr_4, srf_4])  # -> Breps, Closed
offset_4 = Offset(Surface=debrep_4.Faces, Distance="0.4", Retrim=True)

# ---- group: optimizer
galapagos = Galapagos(
    fitness=addition,
    gene=[number_slider_5, number_slider, number_slider_3, number_slider_7, number_slider_6, number_slider_4, number_slider_9, number_slider_8, number_slider_2, number_slider_12, number_slider_11, number_slider_10])

# ---- group: domainsize, cellsize, origin
pt = Point(Point(0, -80.12061528, 3.145966993))
panel = Panel("1")
panel_2 = Panel(["250", "100", "40"])
panel_3 = Panel("2.5")
division = Division(A=["250", "100"], B=panel)
division_2 = Division(A="40", B=panel_3)
panel_4 = Panel([division, division_2])

# ---- group: discretizer & geometry
mesh = Mesh([join.Breps, join_4.Breps, join_2.Breps, join_3.Breps])
discretize_meshes = GHDiscrMesh(Xyzsize=panel_2, Xyzcells=panel_4, SolidMesh=mesh, Origin=pt)  # -> Boxes, CubesAsDoubles

# ----
srf_5 = Surface(offset_4)
srf_6 = Surface(offset_2)
srf_7 = Surface(offset)
srf_8 = Surface(offset_3)
mesh_uv = MeshSurface(Surface=srf_8, UCount="3", VCount="3", Overhang=True, Equalize=False)
mesh_uv_2 = MeshSurface(Surface=srf_6, UCount="3", VCount="3", Overhang=True, Equalize=False)
mesh_uv_3 = MeshSurface(Surface=srf_5, UCount="3", VCount="3", Overhang=True, Equalize=False)

# ---- group: mean_dt
panel_5 = Panel("10")

# ---- group: horizon (timestep 0.5 currently)
panel_6 = Panel("25")

# ----
mesh_uv_4 = MeshSurface(Surface=srf_7, UCount="3", VCount="3", Overhang=True, Equalize=False)

# ---- group: export geometry to a .csv
export_geometry = GHExportGeometry(CubesAsDoubles=discretize_meshes.CubesAsDoubles, Path="c:\_CHRIS\geometry.csv", Export=Button())

# ---- group: write residuals?
toggle_2 = BooleanToggle(False)

# ---- group: Solver
ffd_v2 = FFDSolverV2(
    DomainSize=panel_2,
    DomainDiscretization=panel_4,
    Geometry=discretize_meshes.CubesAsDoubles,
    TimeStep="0.5",
    Horizon=panel_6,
    WindSpeed="10",
    Terrain=Slider(3, range=0..3),
    Run=toggle,
    Results=Toggle(True),
    SolverParameters="1.511e-5;1e-4;1;30;2;false;0.7;false;0.1",
    Residuals=toggle_2,
    Mean_dt=panel_5)  # -> VCentred, PCentred, VStaggered, PStaggered, DE, ObstDomain

# ---- group: analysis surfaces
mesh_2 = Mesh(mesh_uv)

# ----
mesh_3 = Mesh(mesh_uv_3)
mesh_4 = Mesh(mesh_uv_2)
mesh_5 = Mesh(mesh_uv_4)
number_slider_13 = Slider(-0.381, range=-1..0)
number_slider_14 = Slider(0.33, range=0..1)

# ---- group: Visualize Results
number_slider_15 = Slider(2, range=0..100)
number_slider_16 = Slider(39.218, range=0..5000)
number_slider_17 = Slider(65.092, range=0..5000)
number_slider_18 = Slider(2, range=0..2)
toggle_3 = BooleanToggle(True)
field_visualizer = FFDDynamicFieldVisualizer(
    Origin=pt,
    XyzSection=number_slider_18,
    SectionPosition=number_slider_15,
    Min=number_slider_16,
    Max=number_slider_17,
    Velocity=ffd_v2.VStaggered,
    Pressure=ffd_v2.PStaggered,
    Hx=panel,
    Hy=panel,
    Hz=panel_3,
    ShowPressure=toggle_3,
    ColourSheme=Slider(1, range=0..2))
vector_visualizer = FFDDynamicVectorVisualizer(
    Origin=pt,
    XyzSection=number_slider_18,
    SectionPosition=number_slider_15,
    Min=number_slider_16,
    Max=number_slider_17,
    Velocity=ffd_v2.VCentred,
    Pressure=ffd_v2.PCentred,
    Hx=panel,
    Hy=panel,
    Hz=panel_3,
    ShowPressure=toggle_3,
    ColourSheme=Slider(2, range=0..2))

# ----
pt_2 = Point(Point(0, -80.12061528, 13.14596699))
cp_visualizer = CpVisualizer(
    Origin=pt,
    Mesh=mesh_2,
    DE=ffd_v2.DE,
    Min=number_slider_13,
    Max=number_slider_14,
    ColourSheme="1",
    FontSize="0.1",
    RefZ=pt_2)  # -> CpMesh, Txt, Cps
cp_visualizer_2 = CpVisualizer(
    Origin=pt,
    Mesh=mesh_5,
    DE=ffd_v2.DE,
    Min=number_slider_13,
    Max=number_slider_14,
    ColourSheme="1",
    FontSize="0.1",
    RefZ=pt_2)  # -> CpMesh, Txt, Cps
cp_visualizer_3 = CpVisualizer(
    Origin=pt,
    Mesh=mesh_4,
    DE=ffd_v2.DE,
    Min=number_slider_13,
    Max=number_slider_14,
    ColourSheme="1",
    FontSize="0.1",
    RefZ=pt_2)  # -> CpMesh, Txt, Cps
cp_visualizer_4 = CpVisualizer(
    Origin=pt,
    Mesh=mesh_3,
    DE=ffd_v2.DE,
    Min=number_slider_13,
    Max=number_slider_14,
    ColourSheme="1",
    FontSize="0.1",
    RefZ=pt_2)  # -> CpMesh, Txt, Cps
num = Number(flatten(cp_visualizer.Cps))
num_2 = Number(flatten(cp_visualizer_2.Cps))
num_3 = Number(flatten(cp_visualizer_3.Cps))
num_4 = Number(flatten(cp_visualizer_4.Cps))

# ---- group: Min stDev
c_script = CSharpScript(b1=num, b2=num_3, b3=num_4, b4=num_2)  # -> out, stdev; inputs b1: list of Double, b2: list of Double, b3: list of Double, b4: list of Double
# ---------- c_script: C# ----------
    List<double> absCp_b = new List<double>();
    absCp_b.Add(0);
    absCp_b.Add(0);
    absCp_b.Add(0);
    absCp_b.Add(0);

    for (int i = 0; i < b1.Count; i++)
    {
      absCp_b[0] += Math.Abs(b1[i]);
      absCp_b[1] += Math.Abs(b2[i]);
      absCp_b[2] += Math.Abs(b3[i]);
      absCp_b[3] += Math.Abs(b4[i]);
    }

    double absCp = absCp_b[0] + absCp_b[1] + absCp_b[2] + absCp_b[3];
    double meancp = absCp / 4;

    double num = 0;
    for (int i = 0; i < 4; i++)
    {
      num += Math.Pow(absCp_b[i] - meancp, 2);
    }

    double sigma;
    sigma = Math.Sqrt(num / 4);

    stdev = sigma;
# ---------- end c_script ----------

# ---- group: Max sum abs cp
c_script_2 = CSharpScript(b1=num, b2=num_3, b3=num_4, b4=num_2)  # -> out, A; inputs b1: list of Double, b2: list of Double, b3: list of Double, b4: list of Double
# ---------- c_script_2: C# ----------
    double absCp = 0;
    for (int i = 0; i < b1.Count; i++)
    {
      absCp += Math.Abs(b1[i]);
      absCp += Math.Abs(b2[i]);
      absCp += Math.Abs(b3[i]);
      absCp += Math.Abs(b4[i]);
    }

    A = absCp;
# ---------- end c_script_2 ----------

# ----
multiplication_5 = Multiplication(A=c_script.stdev, B="10")
multiplication_6 = Multiplication(A=c_script_2.A, B="-1")

# ---- group: Minimize weighted sum
addition = Addition(A=multiplication_6, B=multiplication_5)

# ----
panel_7 = Panel(addition)
