# Grasshopper definition 200528_Highrise.gh (Grasshopper 1.0.7)
# plug-ins: GHWind

# ---- group: decision variables
number_slider = Slider(0.218, range=-0.5..0.5)
number_slider_2 = Slider(-0.134, range=-0.5..0.5)

# ---- group: Geometry
pt = Point(Point(0, 0, 310))
crv = Curve(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)
crv_2 = Curve(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)
pt_2 = Point(Point(0, 0, 0))
scale = Scale(Geometry=crv_2, Center=pt, Factor="0.4")  # -> Geometry, Transform
multiplication = Multiplication(A=number_slider, B="Pi")
multiplication_2 = Multiplication(A=number_slider_2, B="Pi")
rotate = Rotate(Geometry=crv, Angle=multiplication_2, Plane=pt_2)  # -> Geometry, Transform
addition = Addition(A=multiplication_2, B=multiplication)
rotate_2 = Rotate(Geometry=scale.Geometry, Angle=addition, Plane=pt)  # -> Geometry, Transform
srf = Surface([rotate.Geometry, rotate_2.Geometry])
loft = Loft(
    Curves=[rotate.Geometry, rotate_2.Geometry],
    Options={Adjust=False, Closed=False, LoftEnds=0, LoftSimp=0, LoftType=0, Rebuild=10, Refit=0.01})
join = BrepJoin(Breps=[loft, srf])  # -> Breps, Closed
mesh = Mesh(join.Breps)

# ---- group: optimizer
galapagos = Galapagos(fitness=num, gene=[number_slider_2, number_slider])

# ---- group: domainsize, cellsize, origin
pt_3 = Point(Point(-221.3762254, -149.7847225, -1.50787176))
panel = Panel("5")
panel_2 = Panel("5")
panel_3 = Panel(["600", "300", "500"])
division = Division(A=["600", "300"], B=panel)
division_2 = Division(A="500", B=panel_2)
panel_4 = Panel([division, division_2])

# ---- group: discretizer & geometry
mesh_2 = Mesh(mesh)
discretize_meshes = GHDiscrMesh(Xyzsize=panel_3, Xyzcells=panel_4, SolidMesh=mesh_2, Origin=pt_3)  # -> Boxes, CubesAsDoubles

# ---- group: Solver. Turn on before optimization
ffd_v2 = FFDSolverV2(
    DomainSize=panel_3,
    DomainDiscretization=panel_4,
    Geometry=discretize_meshes.CubesAsDoubles,
    TimeStep="0.5",
    Horizon="20",
    WindSpeed="10",
    Terrain=Slider(3, range=0..3),
    Run=Toggle(False),
    Results=Toggle(True),
    SolverParameters="1.511e-5;1e-4;1;20;2;false;0.7;false;0.1",
    Residuals=Toggle(False),
    Mean_dt="10")  # -> VCentred, PCentred, VStaggered, PStaggered, DE, ObstDomain

# ---- group: wind pressure coefficient
offset = Offset(Surface=loft, Distance="5", Retrim=True)
mesh_uv = MeshSurface(Surface=offset, UCount="30", VCount="10", Overhang=True, Equalize=False)
pt_4 = Point(Point(8.852217674, -10.01953823, 309.0624164))
cp_visualizer = CpVisualizer(
    Origin=pt_3,
    Mesh=mesh_uv,
    DE=ffd_v2.DE,
    Ρ="1.2",
    Min=Slider(-1, range=-1..0),
    Max=Slider(1, range=0..1),
    ColourSheme=Slider(1, range=0..2),
    FontSize=Slider(1, range=0..2),
    RefZ=pt_4)  # -> CpMesh, Txt, Cps

# ---- group: Visualize Results
number_slider_3 = Slider(13, range=0..100)
number_slider_4 = Slider(2, range=0..2)
number_slider_5 = Slider(0, range=0..5000)
number_slider_6 = Slider(35, range=0..5000)
toggle = BooleanToggle(False)
vector_visualizer = FFDDynamicVectorVisualizer(
    Origin=pt_3,
    XyzSection=number_slider_4,
    SectionPosition=number_slider_3,
    Min=number_slider_5,
    Max=number_slider_6,
    Velocity=ffd_v2.VCentred,
    Pressure=ffd_v2.PCentred,
    Hx=panel,
    Hy=panel,
    Hz=panel_2,
    ShowPressure=toggle,
    ColourSheme=Slider(1, range=0..2))
field_visualizer = FFDDynamicFieldVisualizer(
    Origin=pt_3,
    XyzSection=number_slider_4,
    SectionPosition=number_slider_3,
    Min=number_slider_5,
    Max=number_slider_6,
    Velocity=ffd_v2.VStaggered,
    Pressure=ffd_v2.PStaggered,
    Hx=panel,
    Hy=panel,
    Hz=panel_2,
    ShowPressure=toggle,
    ColourSheme=Slider(1, range=0..2))

# ----
abs = Absolute(Value=cp_visualizer.Cps)
panel_5 = Panel(abs)
ma = MassAddition(Input=panel_5)  # -> Result, PartialResults

# ---- group: Objective: Minimize absolute Cp
num = Number(ma.Result)
